# Grasshopper definition 2Rm_VAVReheat.gh (Grasshopper 0.9.76)
# plug-ins: Python Interpreter, Ironbug

# Two rooms with VAV Reheat system
ladybug = Ladybug_Ladybug()  # -> Vviiiiiiiiiizzz; plug-in component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
brep = Brep([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])
mass2zone = Honeybee_Masses2Zones(zoneMasses=flatten(brep), maxRoofAngle=30, createHBZones=Toggle(True))  # -> readMe, HBZones; plug-in component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
panel = Panel(mass2zone.HBZones)
honeybee = Honeybee_Honeybee()  # -> Vviiiiiiiiiizzz; plug-in component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
coilhw = Ironbug_CoilHeatingWater()
boilerhw = Ironbug_BoilerHotWater()
pumpvariable = Ironbug_PumpVariableSpeed()
pumpvariable_2 = Ironbug_PumpVariableSpeed()
boilerhw_2 = Ironbug_BoilerHotWater()
vavreheat = Ironbug_AirTerminalSingleDuctVAVReheat(HeatingCoil=coilhw)
spoareset = Ironbug_SetpointManagerOutdoorAirReset(
    SetpointatOutdoorHighTemperature=Slider(50, range=0..100),
    OutdoorHighTemperature=Slider(30, range=0..100),
    SetpointatOutdoorLowTemperature=Slider(80, range=0..100),
    OutdoorLowTemperature=Slider(10, range=0..10))
branches = PlantBranches(Branch1=[boilerhw, pumpvariable], Branch2=[boilerhw_2, pumpvariable_2])
nickname = Ironbug_OutdoorAirSystem()
coilcw = Ironbug_CoilCoolingWater()
coilhw_2 = Ironbug_CoilHeatingWater()
fanvariable = Ironbug_FanVariableVolume()
thermalzone = Ironbug_ThermalZone(HoneybeeZone=mass2zone.HBZones, AirTerminal_=vavreheat)
branches_2 = PlantBranches(Branch1=coilhw, Branch2=coilhw_2)
branches_3 = AirLoopBranches(Branch1=thermalzone)
nickname_2 = Ironbug_PlantLoop(Supply=[branches, spoareset], Demand=branches_2)
airloop = Ironbug_AirLoopHVAC(Supply=[nickname, coilcw, coilhw_2, fanvariable], Demand=branches_3)
nickname_3 = Ironbug_PlantLoop()
nickname_4 = Ironbug_SaveOSModel(PlantLoops=nickname_2, AirLoops=airloop, _write=Toggle(False))
panel_2 = Panel(nickname_4)
