# Grasshopper definition 01_pgn.gh (Grasshopper 0.9.76)
# plug-ins: Archsim, Ironbug, embryoA

panel = Panel("C:\Users\Mingbo\Documents\GitHub\HoneybeeCSharp\doc\testFile\X_4.png")
panel_2 = Panel("C:\Users\Mingbo\Documents\GitHub\HoneybeeCSharp\doc\testFile\AcceleRad_test_IMG_Perspective_CPU@fc.TIF")
panel_3 = Panel("C:\Users\Mingbo\Documents\GitHub\HoneybeeCSharp\doc\testFile\indoor_view_h.HDR")
viewdata = ViewData(ImagePath=panel_2, Scale=Slider(0.5, range=0..1))  # -> imagePath, Value
array_schedule = ArraySchedule(Hours=[1, 1, 1, 1, 1, 1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])
image = ImageFromPath(P=panel_2, S=1)
